# Grasshopper definition G3DP.gh (Grasshopper 1.0.7)

D = Integer(100)
P = Point(Point(150, 150, 300))
F = Number(600)
B = Surface(<surface referenced from the Rhino model>)
H = Number(5)
D_2 = Integer(100)
P_2 = Point(Point(150, 150, 300))
F_2 = Number(600)
C = Curve([<curve referenced from the Rhino model> x41])
c_script = CSharpScript(C=C, D=D, P=P, F=F)  # -> out, X, S, T, G; inputs C: list of Curve, D: Int32, P: Point3d, F: Double
# ---------- c_script: C# ----------
    Vector3d VX = new Vector3d(1, 0, 0);
    Vector3d VY = new Vector3d(0, 1, 0);

    List<double> LSDZ = new List<double>();
    int i = 0;
    int IC = C.Count;
    for(i = 0; i < C.Count; i++)
    {
      Curve C0 = C[i];
      BoundingBox BC0 = C0.GetBoundingBox(true);
      Point3d PC0 = BC0.Center;
      double DZ0 = PC0.Z;
      LSDZ.Add(DZ0);
    }
    double[] ADZ = LSDZ.ToArray();
    Curve[] AC = C.ToArray();
    Array.Sort(ADZ, AC);
    List<Curve> LSC = new List<Curve>(AC);

    for(i = 0; i < IC; i++)
    {
      Curve C0 = LSC[0];
      Curve C1 = LSC[i];
      if(i > 0)
      {
        bool BC = Curve.DoDirectionsMatch(C0, C1);
        if (BC == false)
        {
          bool BR = C1.Reverse();
        }
      }
      LSC[i] = C1;
    }

    int j = 0;
    List<Point3d> LSPJ = new List<Point3d>();
    for(i = 0; i < IC - 1; i++)
    {
      Curve C0 = LSC[i];
      Curve C1 = LSC[i + 1];
      Point3d[] PD0, PD1;
      double[] DD0, DD1;
      DD0 = C0.DivideByCount(D, true, out PD0);
      DD1 = C1.DivideByCount(D, true, out PD1);
      for(j = 0; j < D; j++)
      {
        Point3d PDJ0 = PD0[j];
        Point3d PDJ1 = PD1[j];
        double DJ = j / (double) D;
        Point3d PJ = PDJ0 + DJ * (PDJ1 - PDJ0);
        LSPJ.Add(PJ);
      }
    }
    Polyline PL0 = new Polyline(LSPJ);

    List<Point3d> LSPT = new List<Point3d>();
    List<string> LSSG = new List<string>();
    Point3d PC = P;
    int k = 0;
    for(k = 0; k < LSPJ.Count; k++)
    {
      Point3d PK = LSPJ[k];
      Point3d PT = new Point3d(PC.X + PK.X, PC.Y + PK.Y, PC.Z - PK.Z);
      LSPT.Add(PT);
      double DPX = Math.Round(PT.X, 2);
      double DPY = Math.Round(PT.Y, 2);
      double DPZ = Math.Round(PT.Z, 2);
      double DF = Math.Round(F, 2);
      string SG = "G1 " + "F" + DF + " X" + DPX + " Y" + DPY + " Z" + DPZ;
      LSSG.Add(SG);
    }

    X = LSPJ;
    S = PL0;
    T = LSPT;
    G = LSSG;
# ---------- end c_script ----------
c_script_2 = CSharpScript(B=B, H=H, D=D_2, P=P_2, F=F_2)  # -> out, X, S, T, G; inputs B: Brep, H: Double, D: Int32, P: Point3d, F: Double
# ---------- c_script_2: C# ----------
    double DT = 0.01;
    Vector3d VX = new Vector3d(1, 0, 0);
    Vector3d VY = new Vector3d(0, 1, 0);

    BoundingBox BX = B.GetBoundingBox(true);
    Point3d P0 = BX.PointAt(0.5, 0.5, 0.0);
    Point3d P1 = BX.PointAt(0.5, 0.5, 1.0);
    double DZ = P1.Z - P0.Z;

    int i = 0;
    int IC = (int) (DZ / H);
    List<Curve> LSC = new List<Curve>();
    List<Point3d[]> LSPD = new List<Point3d[]>();
    for(i = 0; i <= IC; i++)
    {
      Point3d PT = new Point3d(0, 0, H * i);
      Plane PL = new Rhino.Geometry.Plane(PT, VX, VY);
      Curve[] CI;
      Point3d[] PI;
      bool BI = Rhino.Geometry.Intersect.Intersection.BrepPlane(B, PL, DT, out CI, out PI);
      Curve CX = CI[0];
      if(i > 0)
      {
        Curve CX0 = LSC[0];
        bool BC = Curve.DoDirectionsMatch(CX0, CX);
        if (BC == false)
        {
          bool BR = CX.Reverse();
        }
      }
      LSC.Add(CX);
    }

    int j = 0;
    List<Point3d> LSPJ = new List<Point3d>();
    for(i = 0; i <= IC - 1; i++)
    {
      Curve C0 = LSC[i];
      Curve C1 = LSC[i + 1];
      Point3d[] PD0, PD1;
      double[] DD0, DD1;
      DD0 = C0.DivideByCount(D, true, out PD0);
      DD1 = C1.DivideByCount(D, true, out PD1);
      for(j = 0; j < D; j++)
      {
        Point3d PDJ0 = PD0[j];
        Point3d PDJ1 = PD1[j];
        double DJ = j / (double) D;
        Point3d PJ = PDJ0 + DJ * (PDJ1 - PDJ0);
        LSPJ.Add(PJ);
      }
    }
    Polyline PL0 = new Polyline(LSPJ);

    List<Point3d> LSPT = new List<Point3d>();
    List<string> LSSG = new List<string>();
    Point3d PC = P;

    int k = 0;
    for(k = 0; k < LSPJ.Count; k++)
    {
      Point3d PK = LSPJ[k];
      Point3d PT = new Point3d(PC.X + PK.X, PC.Y + PK.Y, PC.Z - PK.Z);
      LSPT.Add(PT);
      double DPX = Math.Round(PT.X, 2);
      double DPY = Math.Round(PT.Y, 2);
      double DPZ = Math.Round(PT.Z, 2);
      double DF = Math.Round(F, 2);
      string SG = "G1 " + "F" + DF + " X" + DPX + " Y" + DPY + " Z" + DPZ;
      LSSG.Add(SG);
    }

    X = LSPJ;
    S = PL0;
    T = LSPT;
    G = LSSG;
# ---------- end c_script_2 ----------
panel = Panel(c_script.G)
panel_2 = Panel(c_script_2.G)
